# Dynamo graph 220511_Kanal_DIM_V0.dyn "220511_Kanal_DIM_mit_Bogen_KVR_SD_BSK" (Dynamo 2.6.1.8786)
# packages: spring nodes 204.1.0, MEPover 2020.6.2, archi-lab.net 2021.25.2521, Clockwork for Dynamo 2.x 2.3.0

select_model_elements_by = DSModelElementsByCategorySelection(index=352)  # "Select Model Elements By Category"; 5 picked in the model; graph input

# group: get all the pipes
code_block = CodeBlock { "Durchmesser"; }
getParameterValueByName = Element.GetParameterValueByName(element=select_model_elements_by, parameterName=code_block)
code_block_2 = CodeBlock { ""; }
eq = getParameterValueByName == code_block_2
filterByBoolMask = List.FilterByBoolMask(list=select_model_elements_by, mask=eq)

# group: get alle the fittings
mep_connector_info = Custom[MEP connector info](Element=filterByBoolMask.out)  # package MEPover; Returns location, connector info and connected elements
flatten = List.Flatten(list=mep_connector_info.ConnectedElements)
uniqueItems = List.UniqueItems(list=flatten)
code_block_3 = CodeBlock { "Luftkanalformteile"; }
ꟿ_list_filterbycategoryname = Custom[ꟿ List.FilterByCategoryName](element=uniqueItems, categoryName=code_block_3)  # package spring nodes; Filters the input elements by their category name. You can input multiple category names.

# group: get all elbows
getFamily = FamilyInstance.GetFamily(familyInstance=ꟿ_list_filterbycategoryname.in)
string_from_object = FromObject(obj=getFamily)
code_block_4 = CodeBlock { "Bogen"; }
contains = String.Contains(str=string_from_object, searchFor=code_block_4)
filterByBoolMask_2 = List.FilterByBoolMask(list=ꟿ_list_filterbycategoryname.in, mask=contains)

# group: Set the new dim on pipes
code_block_5 = CodeBlock { "Volumenstrom"; }
getParameterValueByName_2 = Element.GetParameterValueByName(element=filterByBoolMask.out, parameterName=code_block_5)
calculate_the_dim = Python(IN[0]=getParameterValueByName_2)
# ---------- calculate_the_dim.python (28 lines) ----------
# Phython-Standard- und DesignScript-Bibliotheken laden
import sys
import clr
clr.AddReference('ProtoGeometry')
from Autodesk.DesignScript.Geometry import *

# Die Eingaben für diesen Block werden in Form einer Liste in den IN-Variablen gespeichert.
dataEnteringNode = IN

# Code unterhalb dieser Linie platzieren
Vol = IN[0]
Dim=[]
for i in Vol:
	if i >= 651:
		Dim.append(260)
	elif i >401:
		Dim.append(200)
	elif i >251:
		Dim.append(160)
	elif i >151:
		Dim.append(125)
	elif i >51:
		Dim.append(100)
	else:
		Dim.append(80)
# Weisen Sie Ihre Ausgabe der OUT-Variablen zu.

OUT = Dim
# ----------------------------------------
setParameterByName = Element.SetParameterByName(element=filterByBoolMask.out, parameterName=code_block, value=calculate_the_dim)

# group: delete the old elbows and make new elbows
mep_connector_info_2 = Custom[MEP connector info](Element=filterByBoolMask_2.in)
get_the_connected_pipes = Python(IN[0]=mep_connector_info_2.ConnectedElements)
# ---------- get_the_connected_pipes.python (20 lines) ----------
# Phython-Standard- und DesignScript-Bibliotheken laden
import sys
import clr
clr.AddReference('ProtoGeometry')
from Autodesk.DesignScript.Geometry import *

# Die Eingaben für diesen Block werden in Form einer Liste in den IN-Variablen gespeichert.
dataEnteringNode = IN

# Code unterhalb dieser Linie platzieren
pipelist1 = list()
pipelist2 = list()
for list in IN:
	for elements in list:
		pipelist1.append(elements[0])
		pipelist2.append(elements[1])

#[pipelist1,pipelist2]
# Weisen Sie Ihre Ausgabe der OUT-Variablen zu.
OUT = [pipelist1,pipelist2]
# ----------------------------------------
passthrough = Custom[Passthrough](passThrough=filterByBoolMask_2.in, waitFor=get_the_connected_pipes)  # package Clockwork for Dynamo 2.x; Forces a sequential order of execution. The node wired into the output of the Passthrough node will be executed *after* the node wired into the waitFor input (e.g. important for some Revit operations). The value of the passThrough input will be passed on to the node wired into the output port of the Passthrough node.
delete = archilab.Revit.Elements.Elements.Delete(element=passthrough)
code_block_6 = CodeBlock(x=get_the_connected_pipes) { x[0]; x[1]; }
passthrough_2 = Custom[Passthrough](passThrough=code_block_6.out1, waitFor=setParameterByName)
byMEPCurves = Custom[MEPFitting.ByMEPCurves](MEPCurve1=code_block_6.out0, MEPCurve2=passthrough_2)  # package MEPover; Creates a UnionFitting or ElbowFitting by 2 MEPCurves (Ducts, Cable Trays, Pipes or Conduits). The output may not always be all the fittings created as Revit sometimes creates extra transition fittings outside of the node transactions.

code_block_7 = CodeBlock { "Luftkanalzubehör"; }
ꟿ_list_filterbycategoryname_2 = Custom[ꟿ List.FilterByCategoryName](element=uniqueItems, categoryName=code_block_7)

# group: get all KVR
getFamily_2 = FamilyInstance.GetFamily(familyInstance=ꟿ_list_filterbycategoryname_2.in)
string_from_object_2 = FromObject(obj=getFamily_2)
code_block_8 = CodeBlock { "CAx RU Volumenstromregler"; }
contains_2 = String.Contains(str=string_from_object_2, searchFor=code_block_8)
filterByBoolMask_3 = List.FilterByBoolMask(list=ꟿ_list_filterbycategoryname_2.in, mask=contains_2)

# group: set the new dim on KVR
code_block_9 = CodeBlock { "Durchmesser"; }
code_block_10 = CodeBlock { "Volumenstrom (L)"; }
getParameterValueByName_3 = Element.GetParameterValueByName(element=filterByBoolMask_3.in, parameterName=code_block_10)
calculate_the_kvr_dim = Python(IN[0]=getParameterValueByName_3)
# ---------- calculate_the_kvr_dim.python (26 lines) ----------
# Phython-Standard- und DesignScript-Bibliotheken laden
import sys
import clr
clr.AddReference('ProtoGeometry')
from Autodesk.DesignScript.Geometry import *

# Die Eingaben für diesen Block werden in Form einer Liste in den IN-Variablen gespeichert.
dataEnteringNode = IN

# Code unterhalb dieser Linie platzieren
Vol = IN[0]
Dim=[]
for i in Vol:
	if i >= 709:
		Dim.append(250)
	elif i >575:
		Dim.append(200)
	elif i >325:
		Dim.append(160)
	elif i >210:
		Dim.append(125)
	else:
		Dim.append(100)
# Weisen Sie Ihre Ausgabe der OUT-Variablen zu.

OUT = Dim
# ----------------------------------------
setParameterByName_2 = Element.SetParameterByName(element=filterByBoolMask_3.in, parameterName=code_block_9, value=calculate_the_kvr_dim)

# group: get all Schalldämpfer
getFamily_3 = FamilyInstance.GetFamily(familyInstance=ꟿ_list_filterbycategoryname_2.in)
string_from_object_3 = FromObject(obj=getFamily_3)
code_block_11 = CodeBlock { "Rohrschalldämpfer"; }
contains_3 = String.Contains(str=string_from_object_3, searchFor=code_block_11)
filterByBoolMask_4 = List.FilterByBoolMask(list=ꟿ_list_filterbycategoryname_2.in, mask=contains_3)

# group: set the pipes before and after KVR the same dim with KVR
mep_connector_info_3 = Custom[MEP connector info](Element=filterByBoolMask_3.in)
flatten_2 = List.Flatten(list=mep_connector_info_3.ConnectedElements)
code_block_12 = CodeBlock { "Durchmesser"; }
passthrough_3 = Custom[Passthrough](passThrough=code_block_12, waitFor=setParameterByName)
code_block_13 = CodeBlock { "Volumenstrom"; }
getParameterValueByName_4 = Element.GetParameterValueByName(element=flatten_2, parameterName=code_block_13)
calculate_the_kvr_dim_2 = Python(IN[0]=getParameterValueByName_4)  # same code as calculate_the_kvr_dim
setParameterByName_3 = Element.SetParameterByName(element=flatten_2, parameterName=passthrough_3, value=calculate_the_kvr_dim_2)

# group: Set the SD dim as the connected bigger pipe
code_block_14 = CodeBlock { "Durchmesser Luftkanal"; }
mep_connector_info_4 = Custom[MEP connector info](Element=filterByBoolMask_4.in)
passthrough_4 = Custom[Passthrough](passThrough=mep_connector_info_4.ConnectedElements, waitFor=setParameterByName_3)
code_block_15 = CodeBlock { "Durchmesser"; }
getParameterValueByName_5 = Element.GetParameterValueByName(element=passthrough_4, parameterName=code_block_15)
get_the_bigger_pipe_dim = Python(IN[0]=getParameterValueByName_5)
# ---------- get_the_bigger_pipe_dim.python (21 lines) ----------
# Phython-Standard- und DesignScript-Bibliotheken laden
import sys
import clr
clr.AddReference('ProtoGeometry')
from Autodesk.DesignScript.Geometry import *

# Die Eingaben für diesen Block werden in Form einer Liste in den IN-Variablen gespeichert.
dataEnteringNode = IN

# Code unterhalb dieser Linie platzieren
pipelist1 = list()

for list in IN[0]:
	biggerpipe = 0
	for elements in list:
		if elements > biggerpipe:
			biggerpipe= elements
	pipelist1.append(biggerpipe)

# Weisen Sie Ihre Ausgabe der OUT-Variablen zu.
OUT = pipelist1
# ----------------------------------------
setParameterByName_4 = Element.SetParameterByName(element=filterByBoolMask_4.in, parameterName=code_block_14, value=get_the_bigger_pipe_dim)

# group: get all BSK
getFamily_4 = FamilyInstance.GetFamily(familyInstance=ꟿ_list_filterbycategoryname_2.in)
string_from_object_4 = FromObject(obj=getFamily_4)
code_block_16 = CodeBlock { "Brandschutzklappe"; }
contains_4 = String.Contains(str=string_from_object_4, searchFor=code_block_16)
filterByBoolMask_5 = List.FilterByBoolMask(list=ꟿ_list_filterbycategoryname_2.in, mask=contains_4)

# group: set the BKS dim
code_block_17 = CodeBlock { "Durchmesser"; }
code_block_18 = CodeBlock { "SC_Volumenstrom"; }
getParameterValueByName_6 = Element.GetParameterValueByName(element=filterByBoolMask_5.in, parameterName=code_block_18)
calculate_the_dim_2 = Python(IN[0]=getParameterValueByName_6)  # same code as calculate_the_dim
setParameterByName_5 = Element.SetParameterByName(element=filterByBoolMask_5.in, parameterName=code_block_17, value=calculate_the_dim_2)
