# Dynamo graph 220512_Kanal_DIM_V1.dyn (Dynamo 2.6.1.8786)
# packages: MEPover 2020.6.2, archi-lab.net 2021.25.2521, Clockwork for Dynamo 2.x 2.3.0, spring nodes 204.1.0

select_model_elements = DSModelElementsSelection()  # 10 picked in the model
code_block = CodeBlock { "Luftkanäle"; }
ꟿ_list_filterbycategoryname = Custom[ꟿ List.FilterByCategoryName](element=select_model_elements, categoryName=code_block)  # package spring nodes; Filters the input elements by their category name. You can input multiple category names.

# group: get all elbows
getFamily = FamilyInstance.GetFamily(familyInstance=ꟿ_list_filterbycategoryname.out)
string_from_object = FromObject(obj=getFamily)
code_block_2 = CodeBlock { "Bogen"; }
contains = String.Contains(str=string_from_object, searchFor=code_block_2)
filterByBoolMask = List.FilterByBoolMask(list=ꟿ_list_filterbycategoryname.out, mask=contains)

# group: get all the pipes
code_block_3 = CodeBlock { "Durchmesser"; }
getParameterValueByName = Element.GetParameterValueByName(element=ꟿ_list_filterbycategoryname.in, parameterName=code_block_3)
code_block_4 = CodeBlock { ""; }
eq = getParameterValueByName == code_block_4
filterByBoolMask_2 = List.FilterByBoolMask(list=ꟿ_list_filterbycategoryname.in, mask=eq)

# group: Set the new dim on pipes
code_block_5 = CodeBlock { "Volumenstrom"; }
getParameterValueByName_2 = Element.GetParameterValueByName(element=filterByBoolMask_2.out, parameterName=code_block_5)
calculate_the_dim = Python(IN[0]=getParameterValueByName_2)
# ---------- calculate_the_dim.python (28 lines) ----------
# Phython-Standard- und DesignScript-Bibliotheken laden
import sys
import clr
clr.AddReference('ProtoGeometry')
from Autodesk.DesignScript.Geometry import *

# Die Eingaben für diesen Block werden in Form einer Liste in den IN-Variablen gespeichert.
dataEnteringNode = IN

# Code unterhalb dieser Linie platzieren
Vol = IN[0]
Dim=[]
for i in Vol:
	if i >= 651:
		Dim.append(260)
	elif i >401:
		Dim.append(200)
	elif i >251:
		Dim.append(160)
	elif i >151:
		Dim.append(125)
	elif i >51:
		Dim.append(100)
	else:
		Dim.append(80)
# Weisen Sie Ihre Ausgabe der OUT-Variablen zu.

OUT = Dim
# ----------------------------------------
setParameterByName = Element.SetParameterByName(element=filterByBoolMask_2.out, parameterName=code_block_3, value=calculate_the_dim)

# group: delete the old elbows and make new elbows
mep_connector_info = Custom[MEP connector info](Element=filterByBoolMask.in)  # package MEPover; Returns location, connector info and connected elements
get_the_connected_pipes = Python(IN[0]=mep_connector_info.ConnectedElements)
# ---------- get_the_connected_pipes.python (20 lines) ----------
# Phython-Standard- und DesignScript-Bibliotheken laden
import sys
import clr
clr.AddReference('ProtoGeometry')
from Autodesk.DesignScript.Geometry import *

# Die Eingaben für diesen Block werden in Form einer Liste in den IN-Variablen gespeichert.
dataEnteringNode = IN

# Code unterhalb dieser Linie platzieren
pipelist1 = list()
pipelist2 = list()
for list in IN:
	for elements in list:
		pipelist1.append(elements[0])
		pipelist2.append(elements[1])

#[pipelist1,pipelist2]
# Weisen Sie Ihre Ausgabe der OUT-Variablen zu.
OUT = [pipelist1,pipelist2]
# ----------------------------------------
code_block_6 = CodeBlock(x=get_the_connected_pipes) { x[0]; x[1]; }
passthrough = Custom[Passthrough](passThrough=code_block_6.out1, waitFor=setParameterByName)  # package Clockwork for Dynamo 2.x; Forces a sequential order of execution. The node wired into the output of the Passthrough node will be executed *after* the node wired into the waitFor input (e.g. important for some Revit operations). The value of the passThrough input will be passed on to the node wired into the output port of the Passthrough node.
byMEPCurves = Custom[MEPFitting.ByMEPCurves](MEPCurve1=code_block_6.out0, MEPCurve2=passthrough)  # package MEPover; Creates a UnionFitting or ElbowFitting by 2 MEPCurves (Ducts, Cable Trays, Pipes or Conduits). The output may not always be all the fittings created as Revit sometimes creates extra transition fittings outside of the node transactions.
passthrough_2 = Custom[Passthrough](passThrough=filterByBoolMask.in, waitFor=byMEPCurves)
delete = archilab.Revit.Elements.Elements.Delete(element=passthrough_2)

# group: get all KVR
getFamily_2 = FamilyInstance.GetFamily(familyInstance=ꟿ_list_filterbycategoryname.out)
string_from_object_2 = FromObject(obj=getFamily_2)
code_block_7 = CodeBlock { "CAx RU Volumenstromregler"; }
contains_2 = String.Contains(str=string_from_object_2, searchFor=code_block_7)
filterByBoolMask_3 = List.FilterByBoolMask(list=ꟿ_list_filterbycategoryname.out, mask=contains_2)

# group: set the new dim on KVR
code_block_8 = CodeBlock { "Durchmesser"; }
code_block_9 = CodeBlock { "Volumenstrom (L)"; }
getParameterValueByName_3 = Element.GetParameterValueByName(element=filterByBoolMask_3.in, parameterName=code_block_9)
calculate_the_kvr_dim = Python(IN[0]=getParameterValueByName_3)
# ---------- calculate_the_kvr_dim.python (26 lines) ----------
# Phython-Standard- und DesignScript-Bibliotheken laden
import sys
import clr
clr.AddReference('ProtoGeometry')
from Autodesk.DesignScript.Geometry import *

# Die Eingaben für diesen Block werden in Form einer Liste in den IN-Variablen gespeichert.
dataEnteringNode = IN

# Code unterhalb dieser Linie platzieren
Vol = IN[0]
Dim=[]
for i in Vol:
	if i >= 709:
		Dim.append(250)
	elif i >575:
		Dim.append(200)
	elif i >325:
		Dim.append(160)
	elif i >210:
		Dim.append(125)
	else:
		Dim.append(100)
# Weisen Sie Ihre Ausgabe der OUT-Variablen zu.

OUT = Dim
# ----------------------------------------
setParameterByName_2 = Element.SetParameterByName(element=filterByBoolMask_3.in, parameterName=code_block_8, value=calculate_the_kvr_dim)

# group: get all Schalldämpfer
getFamily_3 = FamilyInstance.GetFamily(familyInstance=ꟿ_list_filterbycategoryname.out)
string_from_object_3 = FromObject(obj=getFamily_3)
code_block_10 = CodeBlock { "Rohrschalldämpfer"; }
contains_3 = String.Contains(str=string_from_object_3, searchFor=code_block_10)
filterByBoolMask_4 = List.FilterByBoolMask(list=ꟿ_list_filterbycategoryname.out, mask=contains_3)

# group: set the pipes before and after KVR the same dim with KVR
mep_connector_info_2 = Custom[MEP connector info](Element=filterByBoolMask_3.in)
flatten = List.Flatten(list=mep_connector_info_2.ConnectedElements)
code_block_11 = CodeBlock { "Durchmesser"; }
passthrough_3 = Custom[Passthrough](passThrough=code_block_11, waitFor=setParameterByName)
code_block_12 = CodeBlock { "Volumenstrom"; }
getParameterValueByName_4 = Element.GetParameterValueByName(element=flatten, parameterName=code_block_12)
calculate_the_kvr_dim_2 = Python(IN[0]=getParameterValueByName_4)  # same code as calculate_the_kvr_dim
setParameterByName_3 = Element.SetParameterByName(element=flatten, parameterName=passthrough_3, value=calculate_the_kvr_dim_2)

# group: Set the SD dim as the connected bigger pipe
code_block_13 = CodeBlock { "Durchmesser Luftkanal"; }
mep_connector_info_3 = Custom[MEP connector info](Element=filterByBoolMask_4.in)
passthrough_4 = Custom[Passthrough](passThrough=mep_connector_info_3.ConnectedElements, waitFor=setParameterByName_3)
code_block_14 = CodeBlock { "Durchmesser"; }
getParameterValueByName_5 = Element.GetParameterValueByName(element=passthrough_4, parameterName=code_block_14)
get_the_bigger_pipe_dim = Python(IN[0]=getParameterValueByName_5)
# ---------- get_the_bigger_pipe_dim.python (21 lines) ----------
# Phython-Standard- und DesignScript-Bibliotheken laden
import sys
import clr
clr.AddReference('ProtoGeometry')
from Autodesk.DesignScript.Geometry import *

# Die Eingaben für diesen Block werden in Form einer Liste in den IN-Variablen gespeichert.
dataEnteringNode = IN

# Code unterhalb dieser Linie platzieren
pipelist1 = list()

for list in IN[0]:
	biggerpipe = 0
	for elements in list:
		if elements > biggerpipe:
			biggerpipe= elements
	pipelist1.append(biggerpipe)

# Weisen Sie Ihre Ausgabe der OUT-Variablen zu.
OUT = pipelist1
# ----------------------------------------
setParameterByName_4 = Element.SetParameterByName(element=filterByBoolMask_4.in, parameterName=code_block_13, value=get_the_bigger_pipe_dim)

# group: get all BSK
getFamily_4 = FamilyInstance.GetFamily(familyInstance=ꟿ_list_filterbycategoryname.out)
string_from_object_4 = FromObject(obj=getFamily_4)
code_block_15 = CodeBlock { "Brandschutzklappe"; }
contains_4 = String.Contains(str=string_from_object_4, searchFor=code_block_15)
filterByBoolMask_5 = List.FilterByBoolMask(list=ꟿ_list_filterbycategoryname.out, mask=contains_4)

# group: set the BKS dim
code_block_16 = CodeBlock { "Durchmesser"; }
code_block_17 = CodeBlock { "SC_Volumenstrom"; }
getParameterValueByName_6 = Element.GetParameterValueByName(element=filterByBoolMask_5.in, parameterName=code_block_17)
calculate_the_dim_2 = Python(IN[0]=getParameterValueByName_6)  # same code as calculate_the_dim
setParameterByName_5 = Element.SetParameterByName(element=filterByBoolMask_5.in, parameterName=code_block_16, value=calculate_the_dim_2)

todo_list = Python()  # unwired: IN[0]
# ---------- todo_list.python (16 lines) ----------
# Phython-Standard- und DesignScript-Bibliotheken laden
import sys
import clr
clr.AddReference('ProtoGeometry')
from Autodesk.DesignScript.Geometry import *

# Die Eingaben für diesen Block werden in Form einer Liste in den IN-Variablen gespeichert.
dataEnteringNode = IN

# Code unterhalb dieser Linie platzieren
"Todo",
"1Übergangstück",
"2Flexrohr",
"3genaue Dimensionstabelle"
# Weisen Sie Ihre Ausgabe der OUT-Variablen zu.
OUT = 0
# ----------------------------------------
